# Grasshopper definition waffle.gh (Grasshopper 1.0.7)

# ---- group: bottom distance along z of waffel
number_slider = Slider(51, range=0..100)

# ----
# Load Mesh Middle
panel = Panel("C:\Users\Chaoyu\Documents\brg\venice_bridge\waffel\data\seg3.json")
python = GhPythonScript(file_name=panel)  # -> mesh
# ---------- python: Python ----------
__author__ = "Chaoyu"
__version__ = "2021.02.18"

import os
from compas.datastructures import Mesh

FILE_I = os.path.join(file_name)
mesh = Mesh.from_json(FILE_I)

#from compas.geometry import Rotation
#import math as m
#
#T = Rotation.from_axis_and_angle([1, 0, 0], m.pi / 2)
#mesh.transform(T)
# ---------- end python ----------
python_2 = GhPythonScript(mesh=python, dis=number_slider)  # -> z_target
# ---------- python_2: Python ----------
__author__ = "Chaoyu"
__version__ = "2021.02.23"


from compas.datastructures import Mesh

z_min = min(mesh.vertices_attribute('z'))
z_target = z_min - dis
# ---------- end python_2 ----------
panel_2 = Panel(python_2)
panel_3 = Panel("815")
# Load Mesh Handrail
panel_4 = Panel("C:\Users\Chaoyu\Documents\brg\venice_bridge\waffel\data\seg_side.json")
python_3 = GhPythonScript(mesh=python, z_target=panel_2)  # -> b_mesh, closed_mesh; inputs z_target: Int32
# ---------- python_3: Python ----------
__author__ = "Chaoyu"
__version__ = "2021.02.18"

from compas.datastructures import Mesh

b_mesh = mesh.copy()
for vkey in b_mesh.vertices():
    b_mesh.vertex_attribute(vkey, 'z', z_target)


v_bottom = [b_mesh.vertex_coordinates(vkey) for vkey in b_mesh.vertices()]
v_top = [mesh.vertex_coordinates(vkey) for vkey in mesh.vertices()]
v = len(v_bottom)
vertices = v_bottom + v_top

b_mesh.flip_cycles()
faces = []
f_bottom = [b_mesh.face_vertices(fkey) for fkey in b_mesh.faces()]
faces.extend(f_bottom)
f = len(f_bottom)
for fkey in mesh.faces():
    faces.append([vkey + v for vkey in mesh.face_vertices(fkey)])

bdr_vs = b_mesh.vertices_on_boundaries()[0]
for v1, v2 in zip(bdr_vs, bdr_vs[1:]):
    faces.append([v1, v2, v2 + v , v1 + v])
    
closed_mesh = Mesh.from_vertices_and_faces(vertices, faces)
# ---------- end python_3 ----------

# ---- group: check face normal
python_4 = GhPythonScript(mesh=python)  # -> origins, normals; disabled
# ---------- python_4: Python ----------
__author__ = "Chaoyu"
__version__ = "2021.02.24"

import Rhino.Geometry as rg

origins = []
normals = []
for fkey in mesh.faces():
    f_center = mesh.face_center(fkey)
    f_normal = mesh.face_normal(fkey)
    origins.append(rg.Point3d(*f_center))
    normals.append(rg.Vector3d(*f_normal))
# ---------- end python_4 ----------
panel_5 = Panel("100")  # disabled
multiplication = Multiplication(A=python_4.normals, B=panel_5)  # disabled
vdis = VectorDisplay(Anchor=python_4.origins, Vector=multiplication)  # disabled

# ----
python_5 = GhPythonScript(file_name=panel_4)  # -> mesh
# ---------- python_5: Python ----------
__author__ = "Chaoyu"
__version__ = "2021.02.18"

import os
from compas.datastructures import Mesh

FILE_I = os.path.join(file_name)
mesh = Mesh.from_json(FILE_I)

mesh.flip_cycles()
#from compas.geometry import Rotation
#import math as m
#
#T = Rotation.from_axis_and_angle([1, 0, 0], m.pi / 2)
#mesh.transform(T)
# ---------- end python_5 ----------
python_6 = GhPythonScript(mesh=python_5, dis=number_slider)  # -> z_target; same code as python_2
python_7 = GhPythonScript(mesh=python)  # -> r_mesh
# ---------- python_7: Python ----------
__author__ = "Chaoyu"
__version__ = "2021.02.18"

import Rhino.Geometry as rg
from ghpythonlib.components import ConstructMesh

vertices = [mesh.vertex_coordinates(vkey) for vkey in mesh.vertices()]
vertices = [rg.Point3d(*xyz) for xyz in vertices]
faces = [mesh.face_vertices(fkey) for fkey in mesh.faces()]
faces = [rg.MeshFace(*face) for face in faces]
r_mesh = ConstructMesh(vertices, faces)
# ---------- end python_7 ----------
python_8 = GhPythonScript(mesh=python_3.b_mesh)  # -> r_mesh; same code as python_7
python_9 = GhPythonScript(mesh=python_3.closed_mesh)  # -> r_mesh; same code as python_7
panel_6 = Panel(python_6)
python_10 = GhPythonScript(mesh=python_3.b_mesh)  # -> s_p, e_p
# ---------- python_10: Python ----------
__author__ = "Chaoyu"
__version__ = "2021.02.18"

import Rhino.Geometry as rg
from compas.geometry import angle_vectors

#======================== check main direction ==============
# select starting corner
corners = list(mesh.vertices_where({'vertex_degree': 2}))
corner = corners[0]
nbrs = mesh.vertex_neighbors(corner)

# loops direction u
u_loops = []
for (u, v) in mesh.edge_strip((corner, nbrs[0])):
    u_loops.append(mesh.edge_loop((u, v)))

# loops direction v
v_loops = []
for (u, v) in mesh.edge_strip((corner, nbrs[1])):
    v_loops.append(mesh.edge_loop((u, v)))


# compare which direction is more straight, which will be used to align the waffel
# angle evaluation in direction u
u_angles = 0
for loop in u_loops:
    vectors = [mesh.edge_vector(u, v) for (u, v) in loop]
    for v1, v2 in zip(vectors, vectors[1:]):
        u_angles += angle_vectors(v1, v2)
print(u_angles)

# angle evaluation in direction v
v_angles = 0
for loop in v_loops:
    vectors = [mesh.edge_vector(u, v) for (u, v) in loop]
    for v1, v2 in zip(vectors, vectors[1:]):
        v_angles += angle_vectors(v1, v2)
print(v_angles)

if u_angles < v_angles:
    loop = u_loops[(len(u_loops) - 1) // 2]
else:
    loop = v_loops[(len(v_loops) - 1) // 2]

s_p = mesh.vertex_coordinates(loop[0][0])
e_p = mesh.vertex_coordinates(loop[-1][-1])
s_p = rg.Point3d(*s_p)
e_p = rg.Point3d(*e_p)
# ---------- end python_10 ----------
number_slider_2 = Slider(6, range=0..10)

# ---- group: waffle slightly smaller than segment
python_11 = GhPythonScript(b_mesh=python_3.b_mesh)  # -> b_boundary
# ---------- python_11: Python ----------
import Rhino.Geometry as rg
from Rhino.Collections import Point3dList

# bottom boundary
#print(b_mesh.edges_on_boundaries())
pts = []
for vkey in list(b_mesh.vertices_on_boundaries())[0]:
    v_xyz = b_mesh.vertex_coordinates(vkey)
    pts.append(rg.Point3d(*v_xyz))
pts_net = Point3dList(*pts)
b_boundary = rg.Polyline(pts_net)
print(b_boundary)
# ---------- end python_11 ----------
geo = Geometry(python_11)
tri = Triangulate(Mesh=python_9)  # -> Mesh, Count
pline = PolyLine(Vertices=geo, Closed=True)
faceb = FaceBoundaries(Mesh=tri.Mesh)
xy = XYPlane(Origin=Point(0, 0, 0))
offset = OffsetCurve(Curve=pline, Distance="-30", Plane=xy, Corners=1)
boundary = BoundarySurfaces(Edges=faceb)
boundary_2 = BoundarySurfaces(Edges=offset)
join = BrepJoin(Breps=boundary)  # -> Breps, Closed
Z = UnitZ(Factor=Slider(1000, range=0..1000))
extr = Extrude(Base=boundary_2, Direction=Z)
sint = SolidIntersection(BrepsA=extr, BrepsB=join.Breps)

# ----
python_12 = GhPythonScript(mesh=python_5)  # -> a; unedited script template

# ---- group: show face normals
python_13 = GhPythonScript(mesh=python_5)  # -> origins, normals; same code as python_4
multiplication_2 = Multiplication(A=python_13.normals, B="100")
vdis_2 = VectorDisplay(Anchor=python_13.origins, Vector=multiplication_2)

# ----
python_14 = GhPythonScript(mesh=python_5)  # -> r_mesh; same code as python_7
python_15 = GhPythonScript(mesh=python_5)  # -> s_p, e_p; same code as python_10
tri_2 = Triangulate(Mesh=python_8)  # -> Mesh, Count
python_16 = GhPythonScript(mesh=python_5, z_target=panel_6)  # -> b_mesh, closed_mesh; inputs z_target: Int32; disabled; same code as python_3
pt = Point(python_10.s_p)
pt_2 = Point(python_10.e_p)
faceb_2 = FaceBoundaries(Mesh=tri_2.Mesh)
vec2pt = Vector2Pt(PointA=pt, PointB=pt_2, Unitize=Toggle(True))  # -> Vector, Length
pt_3 = Point(python_15.s_p)
pt_4 = Point(python_15.e_p)
panel_7 = Panel("0, 150")
number_slider_3 = Slider(300, range=0..1000)
python_17 = GhPythonScript(mesh=python_16.closed_mesh)  # -> r_mesh; disabled; same code as python_7
multiplication_3 = Multiplication(A=number_slider_2, B="-1")
boundary_3 = BoundarySurfaces(Edges=faceb_2)
Z_2 = UnitZ(Factor=1)
xy_2 = XYPlane(Origin=pt)
vec2pt_2 = Vector2Pt(PointA=pt_3, PointB=pt_4, Unitize=Toggle(True))  # -> Vector, Length
pl = ConstructPlane(Origin=pt, XAxis=vec2pt.Vector, YAxis=Z_2)
join_2 = BrepJoin(Breps=boundary_3)  # -> Breps, Closed
deplane = DeconstructPlane(Plane=pl)  # -> Origin, XAxis, YAxis, ZAxis
project = Project(Geometry=python_14, Plane=PlaneXY(0, 0, 0))  # -> Geometry, Transform
xy_3 = XYPlane(Origin=Point(0, 0, 0))
rotate = Rotate(Geometry=pl, Angle=1.570796327, Plane=xy_2)  # -> Geometry, Transform
multiplication_4 = Multiplication(A=number_slider_2, B="2")
multiplication_5 = Multiplication(A=number_slider_3, B=multiplication_3)
project_2 = Project(Geometry=vec2pt_2.Vector, Plane=xy_3)  # -> Geometry, Transform
vec = Vector(deplane.ZAxis)
Z_3 = UnitZ(Factor=1)
series = Series(Start=Slider(150, range=0..300), Step=Slider(300, range=0..1000), Count=Slider(7, range=0..10))
series_2 = Series(Start=Slider(1, range=0..100), Step=number_slider_3, Count=multiplication_4)
deplane_2 = DeconstructPlane(Plane=rotate.Geometry)  # -> Origin, XAxis, YAxis, ZAxis

# ---- group: platform
debrep = DeconstructBrep(Brep=join_2.Breps)  # -> Faces, Edges, Vertices
item = ListItem(List=debrep.Vertices, Index=0, Wrap=True)
pdecon = Deconstruct(Point=item)  # -> XComponent, YComponent, ZComponent
Z_4 = UnitZ(Factor=1)  # -> expr("-x", UnitVector)
panel_8 = Panel("-50")
multiplication_6 = Multiplication(A=Z_4, B=pdecon.ZComponent)
extr_2 = Extrude(Base=join_2.Breps, Direction=multiplication_6)

# ----
xprod = CrossProduct(VectorA=project_2.Geometry, VectorB=Z_3, Unitize=False)  # -> Vector, Length
multiplication_7 = Multiplication(A=vec, B=multiplication_5)
multiplication_8 = Multiplication(A=vec2pt.Vector, B=series)
multiplication_9 = Multiplication(A=vec, B=series_2)
vdis_3 = VectorDisplay(Anchor=pt_3, Vector=project_2.Geometry)
pl_2 = ConstructPlane(Origin=pt_3, XAxis=project_2.Geometry, YAxis=xprod.Vector)
move = Move(Geometry=pl, Motion=multiplication_7)  # -> Geometry, Transform
multiplication_10 = Multiplication(A=deplane_2.ZAxis, B=Slider(59, range=0..100))
bbox = BoundingBox(Content=python_14, Plane=pl_2)  # -> Box, Box_2
move_2 = Move(Geometry=move.Geometry, Motion=multiplication_9)  # -> flatten(Geometry), Transform
move_3 = Move(Geometry=rotate.Geometry, Motion=multiplication_10)  # -> Geometry, Transform
move_4 = Move(Geometry=move_3.Geometry, Motion=multiplication_8)  # -> Geometry, Transform
brep = Brep(sint)
pln = Plane(move_2.Geometry)
pln_2 = Plane(move_4.Geometry)
bbox_2 = BoundingBox(Content=brep, Plane=pl)  # -> Box, Box_2
box_corners = BoxCorners(Box=bbox_2.Box)  # -> CornerA, CornerB, CornerC, CornerD, CornerE, CornerF, CornerG, CornerH
brep_2 = Brep(bbox_2.Box)
srf4pt = _4PointSurface(CornerA=box_corners.CornerA, CornerB=box_corners.CornerE, CornerC=box_corners.CornerF, CornerD=box_corners.CornerB)
deplane_3 = DeconstructPlane(Plane=pln_2)  # -> Origin, XAxis, YAxis, ZAxis
deplane_4 = DeconstructPlane(Plane=pln)  # -> Origin, XAxis, YAxis, ZAxis
brepinc = PointInBrep(Brep=brep_2, Point=deplane_3.Origin, Strict=False)
srf_cp = SurfaceClosestPoint(Point=deplane_4.Origin, Surface=srf4pt)  # -> Point, UVPoint, Distance
cull = CullPattern(List=pln_2, CullPattern=brepinc)
sort = SortList(Keys=srf_cp.Distance)  # -> Keys, ValuesA
item_2 = ListItem(List=sort.Keys, Index=0, Wrap=True)
Z_5 = UnitZ(Factor=Slider(50, range=0..100))
Z_6 = UnitZ(Factor=Slider(100, range=0..100))
num = Number(item_2)
smaller = SmallerThan(FirstNumber=srf_cp.Distance, SecondNumber=expr("x + 0.0001", num))  # -> SmallerThan, OrEqualTo
cull_2 = CullPattern(List=pln, CullPattern=smaller.SmallerThan)
python_18 = GhPythonScript(planes=cull_2)  # -> origins; inputs planes: list
# ---------- python_18: Python ----------
__author__ = "Chaoyu"
__version__ = "2021.02.23"

import Rhino.Geometry as rg

if len(planes) < 3:
    raise ValueError

i = len(planes) // 2


origin_mid = planes[i].Origin
origin_last = planes[i-1].Origin
origin_next = planes[i+1].Origin
#
#pt1 = rg.Point3d((origin_mid.X + origin_last.X)/2, (origin_mid.Y + origin_last.Y)/2, (origin_mid.Z + origin_last.Z)/2)
#pt2 = rg.Point3d((origin_next.X + origin_mid.X)/2, (origin_next.Y + origin_mid.Y)/2, (origin_next.Z + origin_mid.Z)/2)
#centers = [pt1, pt2]
origins = [origin_last, origin_mid, origin_next]
# ---------- end python_18 ----------
pt_5 = Point(python_18)
item_3 = ListItem(List=pt_5, Index=2, Wrap=True)
item_4 = ListItem(List=pt_5, Index=0, Wrap=True)
item_5 = ListItem(List=pt_5, Index=1, Wrap=True)
vec2pt_3 = Vector2Pt(PointA=item_5, PointB=item_3, Unitize=False)  # -> Vector, Length
vec2pt_4 = Vector2Pt(PointA=item_5, PointB=item_4, Unitize=False)  # -> Vector, Length
line = LineSDL(Start=item_5, Direction=vec2pt_4.Vector, Length="200")
line_2 = LineSDL(Start=item_5, Direction=vec2pt_3.Vector, Length="200")
line_3 = LineSDL(Start=item_5, Direction=vec2pt_4.Vector, Length="100")
line_4 = LineSDL(Start=item_5, Direction=vec2pt_3.Vector, Length="100")
end = EndPoints(Curve=line_2)  # -> Start, End
end_2 = EndPoints(Curve=line)  # -> Start, End
end_3 = EndPoints(Curve=line_4)  # -> Start, End
end_4 = EndPoints(Curve=line_3)  # -> Start, End
merge = Merge(Data1=end_2.End, Data2=end.End)
merge_2 = Merge(Data1=end_4.End, Data2=end_3.End)
pl_3 = ConstructPlane(Origin=merge, XAxis=deplane_2.XAxis, YAxis=deplane_2.YAxis)
pl_4 = ConstructPlane(Origin=merge_2, XAxis=deplane_2.XAxis, YAxis=deplane_2.YAxis)
move_5 = Move(Geometry=pl_3, Motion=Z_5)  # -> Geometry, Transform
move_6 = Move(Geometry=pl_4, Motion=Z_6)  # -> Geometry, Transform
rectangle = Rectangle(Plane=move_5.Geometry, XSize="-25, 25", YSize="-10, 10", Radius=0)  # -> Rectangle, Length
rectangle_2 = Rectangle(Plane=move_6.Geometry, XSize="-25, 25", YSize="-10, 10", Radius=0)  # -> Rectangle, Length
boundary_4 = BoundarySurfaces(Edges=rectangle.Rectangle)
boundary_5 = BoundarySurfaces(Edges=rectangle_2.Rectangle)
multiplication_11 = Multiplication(A=deplane.XAxis, B="1000")
multiplication_12 = Multiplication(A=deplane.XAxis, B="1000")
extr_3 = Extrude(Base=boundary_4, Direction=multiplication_11)
extr_4 = Extrude(Base=boundary_5, Direction=multiplication_12)
merge_3 = Merge(Data1=extr_4, Data2=extr_3)

# ---- group: OSB thickness
number_slider_4 = Slider(18, range=0..100)

# ---- group: bottom plate
Z_7 = UnitZ(Factor=expr("-x", number_slider_4))
extr_5 = Extrude(Base=boundary_2, Direction=Z_7)

# ---- group: tolerance length
number_slider_5 = Slider(300, range=0..500)

# ----
brep_3 = Brep(sint)
pln_3 = Plane(cull)
pln_4 = Plane(cull_2)

sec = BrepPlane(Brep=brep_3, Plane=pln_3)  # -> flatten(Curves), Points
sec_2 = BrepPlane(Brep=brep_3, Plane=pln_4)  # -> Curves, Points
python_19 = GhPythonScript(curves=simplify(sec_2.Curves))  # -> out, boo; inputs curves: tree
# ---------- python_19: Python ----------
__author__ = "Chaoyu"
__version__ = "2021.02.18"

boo = []
for i in range(curves.BranchCount):
    c = curves.Branch(i)
    if not c:
        boo.append(False)
    else:
        boo.append(True)
        
#        firstItems = []
#
#for i in range(tree.BranchCount):
#
#    branchList = tree.Branch(i)
#
#    firstItems.append(branchList[0])
# ---------- end python_19 ----------
cull_3 = CullPattern(List=pln_4, CullPattern=python_19.boo)
crv = Curve(flatten(sec_2.Curves))
crv_2 = Curve(sec.Curves)

project_3 = Project(Geometry=crv, Plane=PlaneXY(0, 0, 0))  # -> Geometry, Transform
explode = Explode(Curve=project_3.Geometry, Recursive=True)  # -> Segments, Vertices
fline = FitLine(Points=explode.Vertices)  # -> flatten(Line)
end_5 = EndPoints(Curve=fline)  # -> Start, End
dist = Distance(PointA=end_5.Start, PointB=end_5.End)
larger = LargerThan(FirstNumber=dist, SecondNumber=number_slider_5)  # -> LargerThan, OrEqualTo
cull_4 = CullPattern(List=crv, CullPattern=larger.LargerThan)

project_4 = Project(Geometry=crv_2, Plane=PlaneXY(0, 0, 0))  # -> Geometry, Transform
explode_2 = Explode(Curve=project_4.Geometry, Recursive=True)  # -> Segments, Vertices
fline_2 = FitLine(Points=explode_2.Vertices)  # -> flatten(Line)
end_6 = EndPoints(Curve=fline_2)  # -> Start, End
dist_2 = Distance(PointA=end_6.Start, PointB=end_6.End)
larger_2 = LargerThan(FirstNumber=dist_2, SecondNumber=number_slider_5)  # -> LargerThan, OrEqualTo
cull_5 = CullPattern(List=crv_2, CullPattern=larger_2.LargerThan)

vec_2 = Vector(deplane_2.ZAxis)
vec_3 = Vector(deplane.ZAxis)
multiplication_13 = Multiplication(A=vec_2, B=number_slider_4)
multiplication_14 = Multiplication(A=vec_3, B=number_slider_4)
pln_5 = Plane(cull_3)
cull_6 = CullPattern(List=pln_5, CullPattern=larger.LargerThan)
crv_3 = Curve(cull_4)
crv_4 = Curve(cull_5)
boundary_6 = BoundarySurfaces(Edges=crv_4)
boundary_7 = BoundarySurfaces(Edges=crv_3)
extr_6 = Extrude(Base=boundary_6, Direction=multiplication_13)
extr_7 = Extrude(Base=boundary_7, Direction=multiplication_14)
pl_5 = ConstructPlane(Origin=pt, XAxis=deplane_2.XAxis, YAxis=deplane_2.ZAxis)
bbx = BrepBrep(BrepA=graft(boundary_6), BrepB=boundary_7)  # -> Curves, Points
brep_4 = Brep(cull_4)
brep_5 = Brep(cull_5)
end_7 = EndPoints(Curve=bbx.Curves)  # -> Start, End
boundary_8 = BoundarySurfaces(Edges=brep_4)
boundary_9 = BoundarySurfaces(Edges=brep_5)
project_5 = Project(Geometry=end_7.Start, Plane=pl_5)  # -> Geometry, Transform
pl_6 = ConstructPlane(Origin=project_5.Geometry, XAxis=deplane.XAxis, YAxis=deplane.ZAxis)
move_7 = Move(Geometry=project_5.Geometry, Motion=multiplication_13)  # -> Geometry, Transform
move_8 = Move(Geometry=move_7.Geometry, Motion=multiplication_14)  # -> Geometry, Transform
rec_2pt = Rectangle2Pt(Plane=pl_6, PointA=project_5.Geometry, PointB=move_8.Geometry, Radius=0)  # -> Rectangle, Length

# ---- group: tolerance for boolean
number_slider_6 = Slider(1.038, range=0..10)

# ----
dist_3 = Distance(PointA=end_7.Start, PointB=end_7.End)
division = Division(A=dist_3, B="2")
multiplication_15 = Multiplication(A=division, B=number_slider_6)
Z_8 = UnitZ(Factor=expr("x/2", dist_3))
move_9 = Move(Geometry=rec_2pt.Rectangle, Motion=Z_8)  # -> Geometry, Transform
Z_9 = UnitZ(Factor=multiplication_15)
extr_8 = Extrude(Base=move_9.Geometry, Direction=Z_9)
extr_9 = Extrude(Base=rec_2pt.Rectangle, Direction=Z_8)
cap = CapHoles(Brep=extr_8)  # -> flatten(Brep)
cap_2 = CapHoles(Brep=extr_9)  # -> flatten(Brep)
sdiff = SolidDifference(BrepsA=extr_6, BrepsB=cap)
sdiff_2 = SolidDifference(BrepsA=extr_7, BrepsB=cap_2)
clean = CleanTree(Data=sdiff, CleanInvalid=True, CleanEmpty=False)
clean_2 = CleanTree(Data=sdiff_2, CleanInvalid=True, CleanEmpty=False)

# ---- group: waffel
brep_6 = Brep(clean)
brep_7 = Brep(clean_2)

# ---- group: bottom_platform
brep_8 = Brep(extr_5)

# ---- group: holes for straps
sdiff_3 = SolidDifference(BrepsA=brep_6, BrepsB=merge_3)

# ----
vec_4 = Vector(vec_2)
vec_5 = Vector(vec_3)
merge_4 = Merge(Data1=brep_7, Data2=sdiff_3, Data3=brep_8)
pln_6 = Plane(cull_6)
pln_7 = Plane(pln_3)

# ---- group: 2d lines
sec_3 = BrepPlane(Brep=graft(brep_7), Plane=graft(pln_6), DataComparison="cross_reference")  # -> Curves, Points
sec_4 = BrepPlane(Brep=graft(brep_6), Plane=graft(pln_7), DataComparison="cross_reference")  # -> Curves, Points
planar = PlanarSrf(Edges=flatten(sec_4.Curves))
planar_2 = PlanarSrf(Edges=flatten(sec_3.Curves))

# ----
box_corners_2 = BoxCorners(Box=planar_2)  # -> CornerA, CornerB, CornerC, CornerD, CornerE, CornerF, CornerG, CornerH
box_corners_3 = BoxCorners(Box=planar)  # -> CornerA, CornerB, CornerC, CornerD, CornerE, CornerF, CornerG, CornerH
pln_8 = Plane(pl)
pln_9 = Plane(rotate.Geometry)
deplane_5 = DeconstructPlane(Plane=pln_8)  # -> Origin, XAxis, YAxis, ZAxis
deplane_6 = DeconstructPlane(Plane=pln_9)  # -> Origin, XAxis, YAxis, ZAxis
pl_7 = ConstructPlane(Origin=box_corners_2.CornerB, XAxis=deplane_5.XAxis, YAxis=deplane_5.YAxis)
xy_4 = XYPlane(Origin=Point(0, 0, 0))
pl_8 = ConstructPlane(Origin=box_corners_3.CornerA, XAxis=deplane_6.XAxis, YAxis=deplane_6.YAxis)
orient = Orient(Geometry=planar_2, Source=pl_7, Target=xy_4)  # -> Geometry, Transform
orient_2 = Orient(Geometry=planar, Source=pl_8, Target=xy_4)  # -> Geometry, Transform

# ---- group: layout
x = Slider(603, range=0..1000)
y = Slider(51, range=0..100)

# ----
dedom2 = DeconstructDomain²(Domain=planar_2)  # -> UComponent, VComponent
dedom2_2 = DeconstructDomain²(Domain=planar)  # -> UComponent, VComponent
dedomain = DeconstructDomain(Domain=dedom2.VComponent)  # -> Start, End
dedomain_2 = DeconstructDomain(Domain=dedom2_2.VComponent)  # -> Start, End
subtraction = Subtraction(A=dedomain.End, B=dedomain.Start)
subtraction_2 = Subtraction(A=dedomain_2.End, B=dedomain_2.Start)
addition = Addition(A=subtraction, B=y)
addition_2 = Addition(A=subtraction_2, B=y)
shift = ShiftList(List=addition_2, Shift=-1, Wrap=False)
shift_2 = ShiftList(List=addition, Shift=-1, Wrap=False)
bnd = Bounds(Numbers=dedom2_2.UComponent)
bnd_2 = Bounds(Numbers=dedom2.UComponent)
domcomp_max_width = DomainComponents(Domain=bnd_2)  # -> Start, End
ma = MassAddition(Input=shift_2)  # -> Result, PartialResults
ma_2 = MassAddition(Input=shift)  # -> Result, PartialResults
domcomp_max_width_2 = DomainComponents(Domain=bnd)  # -> Start, End
merge_5 = Merge(Data1=flatten("0"), Data2=flatten(ma.PartialResults))
merge_6 = Merge(Data1=flatten("0"), Data2=flatten(ma_2.PartialResults))
subtraction_3 = Subtraction(A=domcomp_max_width.Start, B=x)
subtraction_4 = Subtraction(A=domcomp_max_width_2.Start, B=x)
Y = UnitY(Factor=merge_5)
X = UnitX(Factor=subtraction_3)
Y_2 = UnitY(Factor=merge_6)
X_2 = UnitX(Factor=subtraction_4)
vadd = Addition(VectorA=Y, VectorB=X, Unitize=False)  # -> Vector, Length
vadd_2 = Addition(VectorA=Y_2, VectorB=X_2, Unitize=False)  # -> Vector, Length
move_10 = Move(Geometry=orient.Geometry, Motion=vadd.Vector)  # -> Geometry, Transform
move_11 = Move(Geometry=orient_2.Geometry, Motion=vadd_2.Vector)  # -> Geometry, Transform
explode_3 = BrepComponents(Brep=move_10.Geometry)  # -> Faces, Edges, Vertices
explode_4 = BrepComponents(Brep=move_11.Geometry)  # -> Faces, Edges, Vertices

# ---- group: 2d cutting data
join_3 = JoinCurves(Curves=explode_3.Edges, Preserve=False)
# počet bodů Gridu
# počet křivek
# kontrola: tohle musí být 1, jinak to není Planar
# křviky v modelu
# kolik by mělo být rovin
# rozdělení ploch
# plochy
# hrany
join_4 = JoinCurves(Curves=explode_4.Edges, Preserve=False)
